# Dynamo graph Script_Familia_Marca.dyn (Dynamo 2.6.1.8786)

all_elements_in_active_view = ElementsInView()
categories = Categories("OST_PipingSystem")
all_elements_of_category = ElementsOfCategory(Category=categories)
filtro_exclusivo = Python(IN[0]=all_elements_in_active_view, IN[1]=all_elements_of_category)
# ---------- filtro_exclusivo.python (20 lines) ----------
# Carregar as bibliotecas DesignScript e padrão do Python
import sys
import clr
clr.AddReference('ProtoGeometry')
from Autodesk.DesignScript.Geometry import *

# As entradas para este nó serão armazenadas como uma lista nas variáveis IN.
L1 = IN[0]
L2 = IN[1]

# Insira o código abaixo desta linha

L3 = []

for item in L1:
	if not item in L2:
		L3.append(item)

# Atribua a sua saída para a variável OUT.
OUT = L3
# ----------------------------------------
string = StringInput("Marca")
string_2 = StringInput("Tipo")
getParameterValueByName = Element.GetParameterValueByName(parameterName=string_2)  # unwired: element
name = ElementType.Name(elementType=getParameterValueByName)
setParameterByName = Element.SetParameterByName(element=filtro_exclusivo, parameterName=string, value=name)
