# Dynamo graph Script_Quantitativo_Excel.dyn (Dynamo 2.6.1.8786)
# packages: bimorphNodes 4.1.1

# group: Separação das Curvas de Aterramento e Alimentação
categories = Categories("OST_ConduitFitting")
all_elements_of_category = ElementsOfCategory(Category=categories)
views = Views("Quantitativo de Eletroduto")
getData = Revit.Schedule.GetData(scheduleView=views)
separação_de_curvas = Python(IN[0]=all_elements_of_category, IN[1]=getData)
# ---------- separação_de_curvas.python (26 lines) ----------
# Carregar as bibliotecas DesignScript e padrão do Python
import sys
import clr
clr.AddReference('ProtoGeometry')
from Autodesk.DesignScript.Geometry import *

# As entradas para este nó serão armazenadas como uma lista nas variáveis IN.
Curvas = IN[0]
TabElet = IN[1][2:] # As duas primeiras linhas são ignoradas

# Separa as curvas no número de categorias de diâmetro dos eletrodutos
#diams = [None]*len(TabElet)

for curva in Curvas:
	for elet in TabElet:
		# elet[2] é o diâmetro nominal do eletroduto em forma de texto.
		# O texto é um número seguido do caractere ' ' e logo depois 
		# a unidade. Portanto, a primeira palavra da string elet[2] 
		# é o diâmetro procurado.
		elet_diam = float(elet[3].split()[0])
		if curva.GetParameterValueByName("Diâmetro nominal") == elet_diam:
			curva.SetParameterByName("Tipo de serviço", elet[4])
			break

# Atribua a sua saída para a variável OUT.
OUT = Curvas
# ----------------------------------------
string = StringInput("Tipo de serviço")
getParameterValueByName = Element.GetParameterValueByName(element=separação_de_curvas, parameterName=string)

# group: Diretório do Projeto Atual
current = Document.Current()
filePath = Document.FilePath(document=current)
directoryName = FileSystem.DirectoryName(path=filePath)

# group: Quantitativo de cabos original do Revit
views_2 = Views("Quantitativo de Cabos")
getData_2 = Revit.Schedule.GetData(scheduleView=views_2)

# group: Correção do Quantitativo Total
correção_quantitativo_de_cabos = Python(IN[0]=getData_2, IN[1]=separação_de_curvas, IN[2]=getData)
# ---------- correção_quantitativo_de_cabos.python (57 lines) ----------
# Carregar as bibliotecas DesignScript e padrão do Python
import sys
import clr
clr.AddReference('ProtoGeometry')
from Autodesk.DesignScript.Geometry import *
import math as m

# As entradas para este nó serão armazenadas como uma lista nas variáveis IN.
Cabos = IN[0][2:]
Curvas = IN[1]
Eletrodutos = IN[2][2:]

# Insira o código abaixo desta linha

# Calcula o comprimento do caminho de eletroduto entre o trafo e 
# o cubículo de medição e proteção

Tam_Ali = 0 # tamanho total do caminho de alimentação
Tam_Aterr = 0 # tamanho total do caminho de aterramento

L = []

# Comprimento das curvas

for curva in Curvas:
	if curva.GetParameterValueByName("Tipo de serviço") == "Alimentação":
		Tam_Ali += float(curva.GetParameterValueByName("Raio de curvatura"))
	elif curva.GetParameterValueByName("Tipo de serviço") == "Aterramento":
		Tam_Aterr += float(curva.GetParameterValueByName("Raio de curvatura"))
		
Tam_Ali *= 1e-3*m.pi/2
Tam_Aterr *= 1e-3*m.pi/2
		
# Comprimento dos eletrodutos

for elet in Eletrodutos:
	if elet[4] == "Alimentação":
		Tam_Ali += float(elet[2])
	elif elet[4] == "Aterramento":
		Tam_Aterr += float(elet[2])

# Faz a alteração no comprimento dos cabos

Cabos_corr = Cabos[:] # cria uma cópia da lista de cabos

for cabo in Cabos_corr:
	comp_revit = float(cabo[2])
	if cabo[5] == ".Trafo saída BT":
	   	# Trata-se da alimentação.
		comp_cabo = (comp_revit + Tam_Ali) * int(cabo[4])
		cabo[2] = comp_cabo
	elif cabo[5] == ".Aterramento Subestação":
		comp_cabo = comp_revit + Tam_Aterr
		cabo[2] = comp_cabo
		
# Atribua a sua saída para a variável OUT.
OUT = Cabos_corr
# ----------------------------------------
views_3 = Views("Quantitativo - Subestação")
getData_3 = Revit.Schedule.GetData(scheduleView=views_3)
quantitativo_final = Python(IN[0]=correção_quantitativo_de_cabos, IN[1]=getData, IN[2]=getData_3)
# ---------- quantitativo_final.python (52 lines) ----------
# Carregar as bibliotecas DesignScript e padrão do Python
import sys
import clr
clr.AddReference('ProtoGeometry')
from Autodesk.DesignScript.Geometry import *

# As entradas para este nó serão armazenadas como uma lista nas variáveis IN.
Cabos = IN[0]
Eletrodutos = IN[1][2:]
SE = IN[2][2:]

# Insira o código abaixo desta linha

Quantitativo = [["Item", "Quantidade"]]

for item in Cabos:
	#cabo = item[0].split(': ')[1]
	Quantitativo.append([item[1], float(item[2])])
	
# Verifica se há itens iguais separados
for i in range(1,len(Quantitativo)-2):
	if Quantitativo[i][0] == Quantitativo[i+1][0]:
		Quantitativo[i][1] += Quantitativo[i+1][1]
		del Quantitativo[i+1]
	
for item in Eletrodutos:
	Quantitativo.append([item[1], float(item[2])])
	
# Aproxima os comprimentos para o inteiro mais próximo e adiciona 
# a unidade 'm' (metro) para melhor leitura da equipe de orçamento

for item in Quantitativo[1:]:
	item[1] = str(round(item[1])) + " m"
	
# Obtém o tamanho da lista contando apenas cabos e eletrodutos
old_len = len(Quantitativo)

for item in SE:
	if "Arame de Aço Galvanizado" in item[0]:
		Quantitativo.append([item[1], "2 kg"])
	else:
		Quantitativo.append([item[1], item[2]])
		
# Verifica se há itens iguais separados
for i in range(old_len,len(Quantitativo)-2):
	if Quantitativo[i][0] == Quantitativo[i+1][0]:
		Quantitativo[i][1] = int(Quantitativo[i][1]) + int(Quantitativo[i+1][1])
		del Quantitativo[i+1]
	

# Atribua a sua saída para a variável OUT.
OUT = Quantitativo
# ----------------------------------------

# group: Exporta o quantitativo para o Excel
string_2 = StringInput("\Quantitativo - SE Aérea")
concat = String.Concat(string0=directoryName, string1=string_2)
string_3 = StringInput("Quantitativo - Subestação Aérea")
code_block = CodeBlock { 0; }
boolean = BoolSelector(true)
exportExcel = Data.ExportExcel(filePath=concat, sheetName=string_3, startRow=code_block, startCol=code_block, data=quantitativo_final, overWrite=boolean)
watch = Watch(concat)
